# Grasshopper definition gh_debug.gh (Grasshopper 1.0.7)
# plug-ins: Human

constrloc = LBConstructLocation(name="BeitShean", latitude="32.4971", longitude="35.4973", time_zone="2.0", elevation=0)  # -> location; plug-in component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

hours = Panel("""11
12
13""")

# ----
# Set period
months = Panel("12")
hoy = LBCalculateHOY(month=graft(months), day="21", hour=hours)  # -> flatten(hoy), flatten(doy), flatten(date); plug-in component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
pt = Point(Point(0, -1.783963043, 0))
sunpath = LBSunPath(location=constrloc, hoys=hoy.hoy, center_pt=pt, scale=1)  # -> report, vectors, altitudes, azimuths, hoys, sun_pts, analemma, daily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; plug-in component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

# ----
# CONTEXT
# Window to shade
# Context
geo = Geometry(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)
brep = Brep(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)
brep_2 = Brep([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])

edges = BrepEdges(Brep=[geo, brep, brep_2])  # -> Naked, Interior, NonManifold

# ----
# DISPLAY
# Display boundries
# Display Surfaces
# Display windows' surfaces
# Display context surfaces
number_slider = Slider(0.3, range=0..1)
ext = ExtendCurve(Curve=[edges.Naked, edges.Interior], Type=0, Start=number_slider, End=number_slider)
preview = CustomPreview(Geometry=ext, Shader=ColourSwatch(SwatchColor=RGB(95, 95, 95)))
preview_2 = CustomPreview(Geometry=geo, Shader=ColourSwatch(SwatchColor=RGB(159, 198, 209)))
preview_3 = CustomPreview(Geometry=[brep, brep_2], Shader=ColourSwatch(SwatchColor=RGBA(177, 179, 178, 122)))

preview_4 = CustomPreview(Geometry=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, Shader=ColourSwatch(SwatchColor=RGB(0, 149, 255)))
preview_5 = CustomPreview(Shader=ColourSwatch(SwatchColor=RGB(89, 0, 255)))

# ----
# SHADING CALCULATOR
# Pick Shading Type
list = ValueList({"Cut profile device": 0, "Pergola with fins": 1}, selected="Cut profile device")
numpergolafins = Slider(20, range=1..20)
finsangle = Slider(45, range=-90..90)
culling_points = ValueList({"No Cull": 0, "Regular Cull (Default)": 1, "High Cull": 2, "Extreme Cull": 3}, selected="No Cull")
shdsrfangle = Slider(0, range=-90..90)
shdsrfshift = Slider(0, range=0..1)
numofshds = Slider(2, range=1..10)
udiv = Slider(4, range=1..20)

# ----
# AntonelloDN:
# you can debug the code using VS, you can use VS 2019 Community.
# 
# Advice:
# 1. code should be clean :) it is not really pythonic
# 2. place a breakpoint and debug step by step the buggy part. You do not need 'print' anymore ;)
# AntonelloDN:
# DO NOT CHANGE THIS COMPONENT! DO NOT OPEN IT!
sunshades_calc = Ladybug_Sun_Shades_Calculator(
    Code="gh_debug.py",
    _SurfaceOrPergola_=list,
    _window=geo,
    _numOfShds_=numofshds,
    _udiv_=udiv,
    _sunVectors=sunpath.vectors,
    Context_=[brep, brep_2],
    _shdSrfAngle_=shdsrfangle,
    _shdSrfShift_=shdsrfshift,
    port_2=numpergolafins,
    port_3=finsangle,
    _delaunayHeight_=Slider(5, range=1..25),
    _offsetFactor_=Slider(50, range=1..50),
    _cullRes_=culling_points,
    Sunshds_=Toggle(True))  # -> Out, PointsOnWindow, UPoints, PtsContext, CullPts, FinalSrf

wires = BrepWireframe(Brep=sunshades_calc.FinalSrf, Density=-1)
# Pergola issues:
# 1. When number os shades is 1, the pergola is detached from the window.
# The length is fine but for some reason it doesn't cover the span between the window and the length of the shade.
# 2. When the number of shades is bigger than 1 it gives a code error. Look for line 826 in code).
# For some reason the number of point is lower than the expected (expects 21 and the count goes to 19 for the case now).
preview_6 = CustomPreview(Geometry=sunshades_calc.FinalSrf, Shader=ColourSwatch(SwatchColor=RGB(255, 255, 0)))
previewlw = CustomPreviewLineweights(Geometry=wires, Shader=ColourSwatch(SwatchColor=RGB(0, 0, 0)), Thickness=Slider(2.7, range=0.1..10), Absolute=False)

dots = DotDisplay(Point=sunshades_calc.CullPts, Colour=RGB(0, 0, 0), Size=Slider(0.03, range=0..1))
